# Grasshopper definition gh_basics_Curve_001.gh (Grasshopper 1.0.7)

# ----
# Parameters
# Parameters
radius = Slider(4.12, range=0..10)
radius_2 = Slider(3.68, range=0..5)
rotation = Slider(0.35, range=-2..2)
y = Slider(-3.3, range=-5..5)
x = Slider(-5, range=-5..5)
z = Slider(-1.67, range=-5..5)
count = Slider(30, range=0..30)
y_2 = Slider(-3.95, range=-5..5)
radius_3 = Slider(0.69, range=0..1)
x_2 = Slider(2.91, range=-5..5)
z_2 = Slider(0.5, range=-5..5)
length = Slider(3, range=0..10)
count_2 = Slider(4, range=0..10)
radius_4 = Slider(0.23, range=0..1)

# ----
# Domains
construct_domain = ConstructDomain(DomainStart=Slider(-5, range=-5..5), DomainEnd=Slider(5, range=-5..5))
construct_domain_2 = ConstructDomain(DomainStart=Slider(-5, range=-5..5), DomainEnd=Slider(5, range=-5..5))
construct_domain_3 = ConstructDomain(DomainStart=Slider(-5, range=-5..5), DomainEnd=Slider(5, range=-5..5))

# ----
# Single Point
construct_point = ConstructPoint(XCoordinate=x_2, YCoordinate=y_2, ZCoordinate=z_2)

# ----
# Ranges
range = Range(Domain=construct_domain, Steps=count)
range_2 = Range(Domain=construct_domain_2, Steps=count)
range_3 = Range(Domain=construct_domain_3, Steps=count)
range_4 = Range(Domain=rotation, Steps=count)

graft_tree = GraftTree(Tree=range, IncludeEmptyLists=True, IncludeNullItems=True)

# ----
# Parameters
radius_5 = Slider(0.31, range=0..1)
cap = Slider(2, range=0..2)
amplitude = Slider(2.61, range=0..10)

# ----
# Rhino 7 Educational Lab
# gh_basics_Curve_001
# Rhino Menu Bar
# Rhino
# Commands
# CURVE
# Point Object
# Single Point
# Multiple Points
# Rhino
# Commands
# Curve
# Closest
# Point
# Mark
# Curve
# Start
# Mark
# Curve
# End
# Mark
# Foci
# Divide Curve By
# Rhino
# Commands
# Length of
# Segments
# Number of
# Segments
construct_point_2 = ConstructPoint(XCoordinate=x, YCoordinate=y, ZCoordinate=z)
construct_point_3 = ConstructPoint(XCoordinate=graft_tree, YCoordinate=range_2, ZCoordinate=range_3)
construct_point_4 = ConstructPoint(XCoordinate=range, YCoordinate=range_2, ZCoordinate=range_3)
ellipse = Ellipse(Plane=PlaneXY(0, 0, 0), Radius1=radius_2, Radius2=radius)  # -> Ellipse, Focus1, Focus2

# ----
# Transformations
pi = Pi(Factor=range_4)
rotate_3d = Rotate3D(Geometry=construct_point_3, Angle=pi, Center=Point(0, 0, 0), Axis=Vector(0, 0, 1))  # -> Geometry, Transform

# ----
# Geometry
# Geometry
# Geometry
# Geometry
point = Point(ellipse.Focus2)
point_2 = Point(ellipse.Focus1)
point_3 = Point(construct_point_2)
point_4 = Point(construct_point_3)
point_5 = Point(construct_point_4)
point_6 = Point(rotate_3d.Geometry)
point_7 = Point(construct_point)

# ----
# Curves
flip_matrix = FlipMatrix(Data=point_6)
interpolate = Interpolate(Vertices=flip_matrix, Degree=3, Periodic=False, KnotStyle=1)  # -> Curve, Length, Domain
curve = Curve(interpolate.Curve)

curve_closest_point = CurveClosestPoint(Point=construct_point, Curve=curve)  # -> Point, Parameter, Distance
end_points = EndPoints(Curve=curve)  # -> Start, End
divide_length = DivideLength(Curve=curve, Length=length)  # -> Points, Tangents, Parameters
divide_curve = DivideCurve(Curve=curve, Count=count_2, Kinks=Toggle(False))  # -> Points, Tangents, Parameters

point_8 = Point(divide_curve.Points)
point_9 = Point(end_points.Start)
point_10 = Point(end_points.End)
point_11 = Point(divide_length.Points)
point_12 = Point(curve_closest_point.Point)

# ----
# Param Viewer
# (Data Structure)
# Panels
panel = Panel(point_5)
panel_2 = Panel(point_4)
panel_3 = Panel(point_7)
panel_4 = Panel(point_6)
panel_5 = Panel(point_12)
panel_6 = Panel(point_10)
panel_7 = Panel(point_9)
panel_8 = Panel(point)
panel_9 = Panel(point_2)
panel_10 = Panel(point_3)
param_viewer = ParamViewer(panel)
param_viewer_2 = ParamViewer(panel_4)
param_viewer_3 = ParamViewer(panel_10)
param_viewer_4 = ParamViewer(panel_2)
param_viewer_5 = ParamViewer(panel_3)
param_viewer_6 = ParamViewer(panel_5)
param_viewer_7 = ParamViewer(panel_6)
param_viewer_8 = ParamViewer(panel_9)
param_viewer_9 = ParamViewer(panel_8)
param_viewer_10 = ParamViewer(panel_7)

panel_11 = Panel(point_8)
panel_12 = Panel(point_11)
param_viewer_11 = ParamViewer(panel_11)
param_viewer_12 = ParamViewer(panel_12)

# ----
# SANDBOX
# (Playground)
# Remap
# with bounds and domain
# Curve
# Closest
# Point
# Geometry
flip_matrix_2 = FlipMatrix(Data=point_6)
interpolate_2 = Interpolate(Vertices=point_6, Degree=3, Periodic=False, KnotStyle=1)  # -> Curve, Length, Domain
interpolate_3 = Interpolate(Vertices=flip_matrix_2, Degree=3, Periodic=False, KnotStyle=1)  # -> Curve, Length, Domain
sphere = Sphere(Base=point_7, Radius=radius_3)
sphere_2 = Sphere(Base=point_12, Radius=radius_3)
sphere_3 = Sphere(Base=point_2, Radius=radius_3)
sphere_4 = Sphere(Base=point, Radius=radius_3)
sphere_5 = Sphere(Base=point_9, Radius=radius_3)
sphere_6 = Sphere(Base=point_10, Radius=radius_3)
sphere_7 = Sphere(Base=point_8, Radius=radius_4)
sphere_8 = Sphere(Base=point_11, Radius=radius_4)
loft = Loft(
    Curves=flatten(interpolate_2.Curve),
    Options={Adjust=False, Closed=False, LoftEnds=0, LoftSimp=0, LoftType=0, Rebuild=10, Refit=0.01})
loft_2 = Loft(
    Curves=flatten(interpolate_3.Curve),
    Options={Adjust=False, Closed=False, LoftEnds=0, LoftSimp=0, LoftType=0, Rebuild=10, Refit=0.01})
surface = Surface(loft_2)
point_13 = Point(ellipse.Focus2)
point_14 = Point(ellipse.Focus1)
curve_2 = Curve(curve)
curve_closest_point_2 = CurveClosestPoint(Point=[point_14, point_13], Curve=curve_2)  # -> Point, Parameter, Distance
flatten_tree = FlattenTree(Tree=curve_closest_point_2.Point, Path="{0}")
dispatch = Dispatch(List=flatten_tree, DispatchPattern=[True, False])  # -> ListA, ListB
line = Line(StartPoint=dispatch.ListA, EndPoint=dispatch.ListB)
point_15 = Point(dispatch.ListB)
point_16 = Point(dispatch.ListA)
deconstruct = Deconstruct(Point=point_16)  # -> XComponent, YComponent, ZComponent
deconstruct_2 = Deconstruct(Point=point_15)  # -> XComponent, YComponent, ZComponent
construct_domain_4 = ConstructDomain(DomainStart="0", DomainEnd="1")
construct_domain_5 = ConstructDomain(DomainStart=0, DomainEnd=1)
bounds = Bounds(Numbers=deconstruct.XComponent)
bounds_2 = Bounds(Numbers=deconstruct.YComponent)
bounds_3 = Bounds(Numbers=deconstruct_2.XComponent)
bounds_4 = Bounds(Numbers=deconstruct_2.YComponent)
remap_numbers = RemapNumbers(Value=deconstruct.XComponent, Source=bounds, Target=construct_domain_4)  # -> Mapped, Clipped
remap_numbers_2 = RemapNumbers(Value=deconstruct.YComponent, Source=bounds_2, Target=construct_domain_4)  # -> Mapped, Clipped
remap_numbers_3 = RemapNumbers(Value=deconstruct_2.XComponent, Source=bounds_3, Target=construct_domain_5)  # -> Mapped, Clipped
remap_numbers_4 = RemapNumbers(Value=deconstruct_2.YComponent, Source=bounds_4, Target=construct_domain_5)  # -> Mapped, Clipped
construct_point_5 = ConstructPoint(XCoordinate=remap_numbers.Mapped, YCoordinate=remap_numbers_2.Mapped, ZCoordinate=0)
construct_point_6 = ConstructPoint(XCoordinate=remap_numbers_3.Mapped, YCoordinate=remap_numbers_4.Mapped, ZCoordinate=0)
evaluate_surface = EvaluateSurface(Surface=reparameterize(surface), Point=construct_point_6)  # -> Point, Normal, UDirection, VDirection, Frame
amplitude_2 = Amplitude(Vector=evaluate_surface.Normal, Amplitude=amplitude)
panel_13 = Panel(evaluate_surface.Point)
move = Move(Geometry=evaluate_surface.Point, Motion=amplitude_2)  # -> Geometry, Transform
point_17 = Point(move.Geometry)

surface_2 = Surface(surface)

evaluate_surface_2 = EvaluateSurface(Surface=reparameterize(surface_2), Point=construct_point_5)  # -> Point, Normal, UDirection, VDirection, Frame
amplitude_3 = Amplitude(Vector=evaluate_surface_2.Normal, Amplitude=amplitude)
negative = Negative(Value=amplitude_3)
panel_14 = Panel(evaluate_surface_2.Point)
move_2 = Move(Geometry=evaluate_surface_2.Point, Motion=negative)  # -> Geometry, Transform
point_18 = Point(move_2.Geometry)
line_2 = Line(StartPoint=point_18, EndPoint=point_17)

# ----
# Geometry
pipe = Pipe(Curve=line_2, Radius=radius_5, Caps=cap)
