# Grasshopper definition gh_basics_Curve_003.gh (Grasshopper 1.0.7)
# plug-ins: Anemone, Kangaroo2 Components, LunchBox

# ----
# Oscillation
trigger = Trigger(Interval=20, TimerInterval=20, Target=data_recorder)
data_recorder = DataRecorder("1", DataLimit=10000, RecordData=True)
list_length = ListLength(List=data_recorder)
division = Division(A=list_length, B=Slider(73, range=0..100))
cosine = Cosine(Value=division)
absolute = Absolute(Value=cosine)
panel = Panel(absolute)

# ----
# Oscillation
trigger_2 = Trigger(Interval=50, TimerInterval=50, Target=data_recorder_2)
data_recorder_2 = DataRecorder("1", DataLimit=100000, RecordData=False)
list_length_2 = ListLength(List=data_recorder_2)
division_2 = Division(A=list_length_2, B=Slider(100, range=0..100))
cosine_2 = Cosine(Value=division_2)
sine = Sine(Value=division_2)
panel_2 = Panel(cosine_2)
panel_3 = Panel(sine)

number_slider = Slider(4, range=0..30)

# ----
# Parameters
repeatloop = Slider(24, range=0..24)
y = Slider(0, range=0..1)
pipe_radius = Slider(0.679, range=0..3)
x = Slider(0.42, range=0..1)
z = Slider(1, range=0..1)
number_slider_2 = Slider(3.38, range=-5..5)
rotation = Slider(0.1, range=0..0.5)
number_slider_3 = Slider(0.51, range=-5..5)
number_slider_4 = Slider(-4.39, range=-5..5)
parameter_t = Slider(1, range=0..1)
amplitude = Slider(45, range=0..100)
parameter = Slider(1, range=0..1)
pipe_radius_2 = Slider(3, range=0..3)
length = Slider(10, range=0..10)
domain = Slider(-5, range=-5..5)
domain_2 = Slider(5, range=-5..5)
cos_amp = Slider(10, range=0..20)
move_in_z = Slider(100, range=0..100)
sin_amp = Slider(22.148, range=0..100)
rotation_2 = Slider(2, range=-1e-06..2)
rotation_3 = Slider(0.11, range=0..2)
move_x = Slider(32, range=0..100)
amplitude_2 = Slider(100, range=0..100)
parameter_2 = Slider(0.62, range=0..1)
parameter_3 = Slider(0.76, range=0..1)
amplitude_3 = Slider(100, range=0..100)
amplitude_4 = Slider(100, range=0..100)
parameter_4 = Slider(0.392088, range=0..1)
parameter_5 = Slider(0.86, range=0..1)
parameter_6 = Slider(0.76, range=0..1)
parameter_7 = Slider(0.805256, range=0..1)
gene_pool = GenePool(Decimals=3, Maximum=1, Minimum=0, Value=[0.212, 0.123, 0.437, 0.898])
number_slider_5 = Slider(12, range=0..100)
md_slider = MDSlider(
    SliderMode=0,
    slider_value=Point(0.5682927108, 0.4853664491, 0.5),
    x_domain=Domain(0, 1),
    y_domain=Domain(0, 1),
    z_domain=Domain(0, 1))

construct_domain = ConstructDomain(DomainStart=domain, DomainEnd=domain_2)
construct_domain_2 = ConstructDomain(DomainStart=domain, DomainEnd=domain_2)
range = Range(Domain=construct_domain_2, Steps=10)
range_2 = Range(Domain=construct_domain, Steps=10)
sine_2 = Sine(Value=range)
cosine_3 = Cosine(Value=range_2)
multiplication = Multiplication(A=cosine_3, B=cos_amp)
multiplication_2 = Multiplication(A=range_2, B=cos_amp)
multiplication_3 = Multiplication(A=sine_2, B=sin_amp)
multiplication_4 = Multiplication(A=range, B=sin_amp)
construct_point = ConstructPoint(XCoordinate=multiplication_2, YCoordinate=multiplication, ZCoordinate=0)
multiplication_5 = Multiplication(A=absolute, B=rotation_2)
construct_point_2 = ConstructPoint(XCoordinate=multiplication_4, YCoordinate=multiplication_3, ZCoordinate=move_in_z)
vector_xyz = VectorXYZ(XComponent=0, YComponent="1", ZComponent=0)  # -> Vector, Length
pi = Pi(Factor=multiplication_5)
pi_2 = Pi(Factor=multiplication_5)
interpolate = Interpolate(Vertices=construct_point, Degree=3, Periodic=False, KnotStyle=1)  # -> Curve, Length, Domain
interpolate_2 = Interpolate(Vertices=construct_point_2, Degree=3, Periodic=False, KnotStyle=1)  # -> Curve, Length, Domain
rotate_3d = Rotate3D(Geometry=interpolate_2.Curve, Angle=pi, Center=Point(0, 0, 0), Axis=Vector(0, 0, 1))  # -> Geometry, Transform
rotate_3d_2 = Rotate3D(Geometry=interpolate.Curve, Angle=pi_2, Center=Point(0, 0, 0), Axis=vector_xyz.Vector)  # -> Geometry, Transform
curve_nearest_object = CurveNearestObject(Curve=rotate_3d_2.Geometry, Geometry=rotate_3d.Geometry)  # -> PointA, PointB, Index

negative = Negative(Value=number_slider_2)
negative_2 = Negative(Value=number_slider_3)
negative_3 = Negative(Value=number_slider_4)
construct_point_3 = ConstructPoint(XCoordinate=number_slider_2, YCoordinate=number_slider_3, ZCoordinate=number_slider_4)
construct_point_4 = ConstructPoint(XCoordinate=negative, YCoordinate=negative_2, ZCoordinate=negative_3)

circle = Circle(Plane=PlaneXY(0, 0, 0), Radius=Slider(12, range=0..100))
evaluate_curve = EvaluateCurve(Curve=reparameterize(circle), Parameter=gene_pool)  # -> Point, Tangent, Angle
explode_tree = ExplodeTree(Data=graft(evaluate_curve.Point))  # -> Branch0, Branch1, Branch2, Branch3
point = Point(explode_tree.Branch0)
point_2 = Point(explode_tree.Branch1)
point_3 = Point(explode_tree.Branch2)
point_4 = Point(explode_tree.Branch3)
line = Line(StartPoint=point, EndPoint=point_2)

construct_point_5 = ConstructPoint(XCoordinate=0, YCoordinate=0, ZCoordinate=0)
construct_point_6 = ConstructPoint(XCoordinate=move_x, YCoordinate=0, ZCoordinate=0)
line_2 = Line(StartPoint=construct_point_5, EndPoint=construct_point_6)
pi_3 = Pi(Factor=rotation_3)
xy_plane = XYPlane(Origin=Point(0, 0, 0))

quad_sphere = QuadSphere(Base=PlaneXY(0, 0, 0), Radius=number_slider_5)
deconstruct_brep = DeconstructBrep(Brep=quad_sphere)  # -> Faces, Edges, Vertices

curve = Curve(rotate_3d_2.Geometry)
line_3 = Line(line)

curve_2 = Curve(interpolate.Curve)
curve_3 = Curve(interpolate_2.Curve)
curve_4 = Curve(interpolate_2.Curve)
curve_5 = Curve(interpolate.Curve)
curve_6 = Curve(interpolate_2.Curve)
curve_7 = Curve(interpolate.Curve)

evaluate_curve_2 = EvaluateCurve(Curve=reparameterize(curve_2), Parameter=parameter_2)  # -> Point, Tangent, Angle
evaluate_curve_3 = EvaluateCurve(Curve=reparameterize(curve_3), Parameter=parameter_3)  # -> Point, Tangent, Angle
amplitude_5 = Amplitude(Vector=evaluate_curve_2.Tangent, Amplitude=amplitude_2)
amplitude_6 = Amplitude(Vector=evaluate_curve_3.Tangent, Amplitude=amplitude_2)

evaluate_curve_4 = EvaluateCurve(Curve=reparameterize(curve_7), Parameter=parameter_4)  # -> Point, Tangent, Angle
evaluate_curve_5 = EvaluateCurve(Curve=reparameterize(curve_4), Parameter=parameter_7)  # -> Point, Tangent, Angle
amplitude_7 = Amplitude(Vector=evaluate_curve_4.Tangent, Amplitude=amplitude_3)
amplitude_8 = Amplitude(Vector=evaluate_curve_5.Tangent, Amplitude=amplitude_3)

evaluate_curve_6 = EvaluateCurve(Curve=reparameterize(curve_5), Parameter=parameter_5)  # -> Point, Tangent, Angle
evaluate_curve_7 = EvaluateCurve(Curve=reparameterize(curve_6), Parameter=parameter_6)  # -> Point, Tangent, Angle
amplitude_9 = Amplitude(Vector=evaluate_curve_6.Tangent, Amplitude=amplitude_4)
amplitude_10 = Amplitude(Vector=evaluate_curve_7.Tangent, Amplitude=amplitude_4)

# ----
# PLUG IN: ANEMONE
vector_xyz_2 = VectorXYZ(XComponent=x, YComponent=y, ZComponent=z)  # -> Vector, Length
pi_4 = Pi(Factor=rotation)

# ----
# Rhino 7 Educational Lab
# gh_basics_Curve_003
# Rhino Menu Bar
# CURVE
# Rhino
# Commands
# Line
# Single Line
# Line Segments
# Perpendicular
# from Curve
# Perpendicular
# to 2 Curves
# Tangent
# from Curve
# Tangent
# from 2 Curves
# Tangent,
# Perpendicular
# Angled
# Bisector
# From
# 4 Points
# Normal
# to Surface
# Verticle
# to (C-)Plane
rotate = Rotate(Geometry=line_2, Angle=pi_3, Plane=xy_plane)  # -> Geometry, Transform
evaluate_curve_8 = EvaluateCurve(Curve=reparameterize(curve), Parameter=absolute)  # -> Point, Tangent, Angle
evaluate_surface = EvaluateSurface(Surface=reparameterize(deconstruct_brep.Faces), Point=md_slider)  # -> Point, Normal, UDirection, VDirection, Frame
vector_display = VectorDisplay(Anchor=evaluate_curve_2.Point, Vector=amplitude_5)
dot_product = DotProduct(VectorA=evaluate_curve_2.Tangent, VectorB=evaluate_curve_3.Tangent, Unitize=False)
vector_display_2 = VectorDisplay(Anchor=evaluate_curve_3.Point, Vector=amplitude_6)
vector_display_3 = VectorDisplay(Anchor=evaluate_curve_4.Point, Vector=amplitude_7)
vector_display_4 = VectorDisplay(Anchor=evaluate_curve_6.Point, Vector=amplitude_9)
line_4 = Line(StartPoint=curve_nearest_object.PointA, EndPoint=curve_nearest_object.PointB)
dot_product_2 = DotProduct(VectorA=evaluate_curve_4.Tangent, VectorB=evaluate_curve_5.Tangent, Unitize=False)
dot_product_3 = DotProduct(VectorA=evaluate_curve_6.Tangent, VectorB=evaluate_curve_7.Tangent, Unitize=False)
vector_display_5 = VectorDisplay(Anchor=evaluate_curve_5.Point, Vector=amplitude_8)
vector_display_6 = VectorDisplay(Anchor=evaluate_curve_7.Point, Vector=amplitude_10)
tween_curve = TweenCurve(CurveA=line_2, CurveB=rotate.Geometry, Factor=0.5, BlendType=0)
line_5 = Line(StartPoint=construct_point_3, EndPoint=construct_point_4)
line_4pt = Line4Pt(Line=line_3, PointA=point_3, PointB=point_4)

line_6 = Line(line_5)

loop_start = LoopStart(Repeat=repeatloop, Trigger=Toggle(False), Data=line_6)  # -> port, Counter, Data
line_7 = Line(loop_start.Data)
end_points = EndPoints(Curve=line_7)  # -> Start, End
point_5 = Point(end_points.Start)
panel_4 = Panel(loop_start.Counter)
rotate_3d_3 = Rotate3D(Geometry=line_7, Angle=pi_4, Center=point_5, Axis=vector_xyz_2.Vector)  # -> Geometry, Transform
orient = Orient(Geometry=rotate_3d_3.Geometry, Source=end_points.Start, Target=end_points.End)  # -> Geometry, Transform
loop_end = LoopEnd(
    port=loop_start.port,
    Exit=Toggle(False),
    Data=orient.Geometry,
    TimeOutVal=0,
    pausedState=False,
    state="Constant & Record")

plane = Plane(evaluate_surface.Frame)
vector = Vector(evaluate_surface.Normal)
amplitude_11 = Amplitude(Vector=vector, Amplitude=number_slider_5)

deconstruct_plane = DeconstructPlane(Plane=plane)  # -> Origin, XAxis, YAxis, ZAxis
line_8 = Line(loop_end)

line_sdl = LineSDL(Start=deconstruct_plane.Origin, Direction=deconstruct_plane.ZAxis, Length=Slider(15, range=0..100))
vector_display_7 = VectorDisplay(Anchor=evaluate_surface.Point, Vector=amplitude_11)
line_9 = Line(tween_curve)
line_10 = Line(line_4pt)

# ----
# Geometry
amplitude_12 = Amplitude(Vector=evaluate_curve_8.Tangent, Amplitude=amplitude)
multipipe = MultiPipe(
    Curves=[line_4, rotate_3d_2.Geometry, rotate_3d.Geometry],
    NodeSize=pipe_radius_2,
    EndOffset=1,
    StrutSize=1,
    Segment=0,
    KinkAngle=0.6,
    CubeFit=0,
    Caps=0)
vector_display_8 = VectorDisplay(Anchor=evaluate_curve_8.Point, Vector=amplitude_12)
line_11 = Line(line_5)
line_12 = Line(line_8)
pipe = Pipe(Curve=line_12, Radius=pipe_radius, Caps=0)
line_13 = Line(rotate.Geometry)

join_curves = JoinCurves(Curves=flatten(line_12), Preserve=False)
curve_8 = Curve(join_curves)
evaluate_curve_9 = EvaluateCurve(Curve=reparameterize(curve_8), Parameter=panel)  # -> Point, Tangent, Angle
curve_frame = CurveFrame(Curve=reparameterize(curve_8), Parameter=panel)
deconstruct_plane_2 = DeconstructPlane(Plane=curve_frame)  # -> Origin, XAxis, YAxis, ZAxis
negative_4 = Negative(Value=[deconstruct_plane_2.XAxis, deconstruct_plane_2.YAxis, deconstruct_plane_2.ZAxis])
dot_product_4 = DotProduct(VectorA=evaluate_curve_9.Tangent, VectorB=deconstruct_plane_2.XAxis, Unitize=False)
vector_2 = Vector([deconstruct_plane_2.YAxis, deconstruct_plane_2.ZAxis, deconstruct_plane_2.XAxis, negative_4])
vector_3 = Vector(evaluate_curve_9.Tangent)
panel_5 = Panel(dot_product_4)
line_sdl_2 = LineSDL(Start=evaluate_curve_9.Point, Direction=vector_2, Length=length)
vector_display_9 = VectorDisplay(Anchor=evaluate_curve_9.Point, Vector=vector_3)
vector_display_10 = VectorDisplay(Anchor=evaluate_curve_9.Point, Vector=vector_2)

curve_9 = Curve(line_sdl_2)

line_14 = Line(curve_9)
pipe_2 = Pipe(Curve=line_14, Radius=pipe_radius_2, Caps=0)

# ----
# Param Viewer
# (Data Structure)
# Panels
panel_6 = Panel(line_14)
panel_7 = Panel(line_12)
panel_8 = Panel(line_4)
panel_9 = Panel(evaluate_curve_8.Tangent)
panel_10 = Panel(line_sdl)
panel_11 = Panel(dot_product)
panel_12 = Panel(line_13)
panel_13 = Panel(dot_product_2)
panel_14 = Panel(line_10)
panel_15 = Panel(amplitude_11)
panel_16 = Panel(line_9)
panel_17 = Panel(dot_product_3)
panel_18 = Panel(line_11)
param_viewer = ParamViewer(panel_17)
param_viewer_2 = ParamViewer(panel_11)
param_viewer_3 = ParamViewer(panel_10)
param_viewer_4 = ParamViewer(panel_12)
param_viewer_5 = ParamViewer(panel_13)
param_viewer_6 = ParamViewer(panel_14)
param_viewer_7 = ParamViewer(panel_9)
param_viewer_8 = ParamViewer(panel_15)
param_viewer_9 = ParamViewer(panel_16)
param_viewer_10 = ParamViewer(panel_6)
param_viewer_11 = ParamViewer(panel_7)
# SANDBOX
# (Playground)
param_viewer_12 = ParamViewer(panel_18)
param_viewer_13 = ParamViewer(panel_8)

end_points_2 = EndPoints(Curve=line_13)  # -> Start, End
end_points_3 = EndPoints(Curve=line_2)  # -> Start, End
end_points_4 = EndPoints(Curve=line_9)  # -> Start, End
domain_3 = Slider(-5, range=-5..5)
domain_4 = Slider(5, range=-5..5)
line_15 = Line(StartPoint=end_points_3.End, EndPoint=end_points_4.End)
line_16 = Line(StartPoint=end_points_2.End, EndPoint=end_points_3.End)
construct_domain_3 = ConstructDomain(DomainStart=domain_3, DomainEnd=domain_4)
construct_domain_4 = ConstructDomain(DomainStart=domain_3, DomainEnd=domain_4)
number_slider_6 = Slider(12, range=0..100)
range_3 = Range(Domain=construct_domain_4, Steps=number_slider)
range_4 = Range(Domain=construct_domain_3, Steps=number_slider)
sine_3 = Sine(Value=range_3)
cosine_4 = Cosine(Value=range_4)
multiplication_6 = Multiplication(A=range_4, B=Slider(10, range=0..100))
multiplication_7 = Multiplication(A=range_3, B=number_slider_6)
multiplication_8 = Multiplication(A=sine_3, B=number_slider_6)
multiplication_9 = Multiplication(A=cosine_4, B=number_slider_6)
construct_point_7 = ConstructPoint(XCoordinate=multiplication_6, YCoordinate=0, ZCoordinate=multiplication_9)
construct_point_8 = ConstructPoint(XCoordinate=multiplication_7, YCoordinate=0, ZCoordinate=multiplication_8)
pi_5 = Pi(Factor=sine_3)
pi_6 = Pi(Factor=cosine_4)
vector_xyz_3 = VectorXYZ(XComponent="1", YComponent=0, ZComponent=0)  # -> Vector, Length
interpolate_3 = Interpolate(Vertices=construct_point_7, Degree=3, Periodic=False, KnotStyle=1)  # -> Curve, Length, Domain
interpolate_4 = Interpolate(Vertices=construct_point_8, Degree=3, Periodic=False, KnotStyle=1)  # -> Curve, Length, Domain
rotate_3d_4 = Rotate3D(Geometry=interpolate_3.Curve, Angle=pi_6, Center=Point(0, 0, 0), Axis=vector_xyz_3.Vector)  # -> Geometry, Transform
rotate_3d_5 = Rotate3D(Geometry=interpolate_4.Curve, Angle=pi_5, Center=Point(0, 0, 0), Axis=vector_xyz_3.Vector)  # -> Geometry, Transform
number_slider_7 = Slider(0.369545, range=0..1)
number_slider_8 = Slider(0.605641, range=0..1)
curve_10 = Curve(rotate_3d_4.Geometry)
curve_11 = Curve(rotate_3d_5.Geometry)
number_slider_9 = Slider(1, range=0..1)
evaluate_curve_10 = EvaluateCurve(Curve=reparameterize(curve_10), Parameter=panel_2)  # -> Point, Tangent, Angle
evaluate_curve_11 = EvaluateCurve(Curve=reparameterize(curve_11), Parameter=panel_3)  # -> Point, Tangent, Angle
amplitude_13 = Amplitude(Vector=evaluate_curve_10.Tangent, Amplitude=number_slider_9)
amplitude_14 = Amplitude(Vector=evaluate_curve_11.Tangent, Amplitude=number_slider_9)
vector_display_11 = VectorDisplay(Anchor=evaluate_curve_10.Point, Vector=amplitude_13)
dot_product_5 = DotProduct(VectorA=evaluate_curve_10.Tangent, VectorB=evaluate_curve_11.Tangent, Unitize=False)
vector_display_12 = VectorDisplay(Anchor=evaluate_curve_11.Point, Vector=amplitude_14)
panel_19 = Panel(dot_product_5)
ghpython_script = GhPythonScript(x=dot_product_5)  # -> out, a
# ---------- ghpython_script: Python ----------
__author__ = "Sculpture"
__version__ = "2022.09.11"

import rhinoscriptsyntax as rs

if 0.1 < x < 1.1:
    a = True
# ---------- end ghpython_script ----------
line_17 = Line(StartPoint=evaluate_curve_10.Point, EndPoint=evaluate_curve_11.Point)
gradient = Gradient(
    LowerLimit=Slider(0.56, range=0..1),
    UpperLimit=Slider(0.79, range=0..1),
    Parameter=dot_product_5,
    stops=[0: RGB(0, 128, 0), 0.5: RGB(255, 255, 0), 1: RGB(255, 0, 0)])
panel_20 = Panel(ghpython_script.a)
object_bake = ObjectBake(
    BakeToggle=ghpython_script.a,
    GeometryObjects=line_17,
    Layer="GH_Bake",
    ObjectName="GH_Obj",
    ObjectColor=gradient,
    LayerColor=RGB(255, 255, 255))
