# Grasshopper definition gh_basics_Curve_003_tutorial.gh (Grasshopper 1.0.7)

# ----
# Parameters
# Parameters
count = Slider(16, range=0..30)
x = Slider(2.63, range=-5..5)
y = Slider(0.018, range=-5..5)
z = Slider(2.517, range=-5..5)
pi_rotation = Slider(-0.49, range=-1..1)
z_2 = Slider(2.261, range=-5..5)
x_2 = Slider(1.192, range=-5..5)
y_2 = Slider(1.369, range=-5..5)
number_slider = Slider(1, range=0..1)

# ----
# Algorithms
# Domains
# Ranges
construct_domain = ConstructDomain(DomainStart=Slider(-4.942, range=-5..5), DomainEnd=Slider(3.093, range=-5..5))
construct_domain_2 = ConstructDomain(DomainStart=Slider(-5, range=-5..5), DomainEnd=Slider(5, range=-5..5))
construct_domain_3 = ConstructDomain(DomainStart=Slider(-5, range=-5..5), DomainEnd=Slider(5, range=-5..5))
pi = Pi(Factor=pi_rotation)
range = Range(Domain=construct_domain, Steps=count)
range_2 = Range(Domain=pi, Steps=count)
range_3 = Range(Domain=construct_domain_2, Steps=count)
range_4 = Range(Domain=construct_domain_3, Steps=count)
graft_tree = GraftTree(Tree=range, IncludeEmptyLists=True, IncludeNullItems=True)

# ----
# Point
construct_point = ConstructPoint(XCoordinate=x_2, YCoordinate=y_2, ZCoordinate=z_2)

# ----
# Parameters
radius = Slider(0.37, range=0..1)
cap = Slider(2, range=0..2)
amplitude = Slider(4.96, range=0..10)

# ----
# Rhino 7 Education Lab
# gh_basics_Curve_003
# Rhino Menu Bar
# CURVE
# Rhino
# commands
# Point Object
# Single Point
# Multiple Point
# Rhino
# commands
# Curve
# Closest
# Point
# Mark
# Curve
# End
# Mark
# Curve
# Start
# Mark
# Foci
construct_point_2 = ConstructPoint(XCoordinate=x, YCoordinate=y, ZCoordinate=z)
construct_point_3 = ConstructPoint(XCoordinate=range, YCoordinate=range_3, ZCoordinate=range_4)
construct_point_4 = ConstructPoint(XCoordinate=graft_tree, YCoordinate=range_3, ZCoordinate=range_4)
ellipse = Ellipse(Plane=PlaneXY(0, 0, 0), Radius1=Slider(5.45, range=0..10), Radius2=Slider(6.37, range=0..10))  # -> Ellipse, Focus1, Focus2

# ----
# Transformation
center = Center(Point(0, 0, 0))
rotate_3d = Rotate3D(Geometry=construct_point_4, Angle=range_2, Center=center, Axis=Vector(0, 0, 1))  # -> Geometry, Transform

# ----
# Geometry
point = Point(rotate_3d.Geometry)
point_2 = Point(construct_point_3)
point_3 = Point(construct_point_2)
point_4 = Point(construct_point)
point_5 = Point(ellipse.Focus1)
point_6 = Point(ellipse.Focus2)

# ----
# Curves
point_7 = Point(point)
simplify_tree = SimplifyTree(Tree=point_7, Front=False)
flip_matrix = FlipMatrix(Data=simplify_tree)
interpolate = Interpolate(Vertices=flip_matrix, Degree=3, Periodic=False, KnotStyle=1)  # -> Curve, Length, Domain
param_viewer = ParamViewer(flip_matrix)
curve = Curve(interpolate.Curve)

curve_2 = Curve(curve)

curve_closest_point = CurveClosestPoint(Point=construct_point, Curve=curve)  # -> Point, Parameter, Distance
end_points = EndPoints(Curve=curve_2)  # -> Start, End

point_8 = Point(curve_closest_point.Point)
point_9 = Point(end_points.Start)
point_10 = Point(end_points.End)

# ----
# Panels
# Param Viewer
panel = Panel(point_8)
panel_2 = Panel(point_4)
panel_3 = Panel(point_3)
panel_4 = Panel(point)
panel_5 = Panel(point_2)
panel_6 = Panel(point_9)
panel_7 = Panel(point_5)
panel_8 = Panel(point_10)
panel_9 = Panel(point_6)
param_viewer_2 = ParamViewer(panel_3)
param_viewer_3 = ParamViewer(panel_5)
param_viewer_4 = ParamViewer(panel_4)
param_viewer_5 = ParamViewer(panel_4)
param_viewer_6 = ParamViewer(panel)
param_viewer_7 = ParamViewer(panel_2)
param_viewer_8 = ParamViewer(panel_8)
param_viewer_9 = ParamViewer(panel_6)
param_viewer_10 = ParamViewer(panel_7)
param_viewer_11 = ParamViewer(panel_9)

flip_matrix_2 = FlipMatrix(Data=point)

# ----
# note the use of expression *
sphere = Sphere(Base=point_8, Radius=expr("x/2", number_slider))

sphere_2 = Sphere(Base=point_10, Radius=expr("x/2", number_slider))
sphere_3 = Sphere(Base=point_9, Radius=expr("x/2", number_slider))
sphere_4 = Sphere(Base=point_4, Radius=number_slider)
sphere_5 = Sphere(Base=point_6, Radius=number_slider)
sphere_6 = Sphere(Base=point_5, Radius=number_slider)
interpolate_2 = Interpolate(Vertices=flip_matrix_2, Degree=3, Periodic=False, KnotStyle=1)  # -> Curve, Length, Domain
interpolate_3 = Interpolate(Vertices=point, Degree=3, Periodic=False, KnotStyle=1)  # -> Curve, Length, Domain
flatten_tree = FlattenTree(Tree=interpolate_3.Curve, Path="{0}")
flatten_tree_2 = FlattenTree(Tree=interpolate_2.Curve, Path="{0}")
loft = Loft(Curves=flatten_tree, Options={Adjust=False, Closed=False, LoftEnds=0, LoftSimp=0, LoftType=0, Rebuild=10, Refit=0.01})
loft_2 = Loft(Curves=flatten_tree_2, Options={Adjust=False, Closed=False, LoftEnds=0, LoftSimp=0, LoftType=0, Rebuild=10, Refit=0.01})

# ----
# SANDBOX
# (Playground)
# Remap
# with bounds and domain
# Curve
# Closest
# Point
# Geometry
surface = Surface(loft_2)
point_11 = Point(point_6)
point_12 = Point(point_5)
curve_3 = Curve(curve)
curve_closest_point_2 = CurveClosestPoint(Point=[point_12, point_11], Curve=curve_3)  # -> Point, Parameter, Distance
flatten_tree_3 = FlattenTree(Tree=curve_closest_point_2.Point, Path="{0}")
dispatch = Dispatch(List=flatten_tree_3, DispatchPattern=[True, False])  # -> ListA, ListB
line = Line(StartPoint=dispatch.ListA, EndPoint=dispatch.ListB)
point_13 = Point(dispatch.ListB)
point_14 = Point(dispatch.ListA)
deconstruct = Deconstruct(Point=point_14)  # -> XComponent, YComponent, ZComponent
deconstruct_2 = Deconstruct(Point=point_13)  # -> XComponent, YComponent, ZComponent
construct_domain_4 = ConstructDomain(DomainStart="0", DomainEnd="1")
bounds = Bounds(Numbers=deconstruct.XComponent)
construct_domain_5 = ConstructDomain(DomainStart=0, DomainEnd=1)
bounds_2 = Bounds(Numbers=deconstruct.YComponent)
bounds_3 = Bounds(Numbers=deconstruct_2.XComponent)
bounds_4 = Bounds(Numbers=deconstruct_2.YComponent)
remap_numbers = RemapNumbers(Value=deconstruct.YComponent, Source=bounds_2, Target=construct_domain_4)  # -> Mapped, Clipped
remap_numbers_2 = RemapNumbers(Value=deconstruct_2.XComponent, Source=bounds_3, Target=construct_domain_5)  # -> Mapped, Clipped
remap_numbers_3 = RemapNumbers(Value=deconstruct.XComponent, Source=bounds, Target=construct_domain_4)  # -> Mapped, Clipped
remap_numbers_4 = RemapNumbers(Value=deconstruct_2.YComponent, Source=bounds_4, Target=construct_domain_5)  # -> Mapped, Clipped
construct_point_5 = ConstructPoint(XCoordinate=remap_numbers_3.Mapped, YCoordinate=remap_numbers.Mapped, ZCoordinate=0)
construct_point_6 = ConstructPoint(XCoordinate=remap_numbers_2.Mapped, YCoordinate=remap_numbers_4.Mapped, ZCoordinate=0)
surface_2 = Surface(surface)
evaluate_surface = EvaluateSurface(Surface=reparameterize(surface_2), Point=construct_point_5)  # -> Point, Normal, UDirection, VDirection, Frame
evaluate_surface_2 = EvaluateSurface(Surface=reparameterize(surface), Point=construct_point_6)  # -> Point, Normal, UDirection, VDirection, Frame
amplitude_2 = Amplitude(Vector=evaluate_surface.Normal, Amplitude=amplitude)
amplitude_3 = Amplitude(Vector=evaluate_surface_2.Normal, Amplitude=amplitude)
negative = Negative(Value=amplitude_2)
panel_10 = Panel(evaluate_surface.Point)
panel_11 = Panel(evaluate_surface_2.Point)
move = Move(Geometry=evaluate_surface.Point, Motion=negative)  # -> Geometry, Transform
move_2 = Move(Geometry=evaluate_surface_2.Point, Motion=amplitude_3)  # -> Geometry, Transform
point_15 = Point(move.Geometry)
point_16 = Point(move_2.Geometry)
line_2 = Line(StartPoint=point_15, EndPoint=point_16)

# ----
# Geometry
pipe = Pipe(Curve=line_2, Radius=radius, Caps=cap)  # disabled
