# Grasshopper definition gh_basics_Curve_003b.gh (Grasshopper 1.0.7)
# plug-ins: LunchBox

circle = Circle(Plane=PlaneXY(0, 0, 0), Radius=Slider(65, range=0..100))

# ----
# Oscillation
trigger = Trigger(Interval=10, TimerInterval=10, Target=data_recorder)
data_recorder = DataRecorder("1", DataLimit=100000, RecordData=True)
list_length = ListLength(List=data_recorder)
division = Division(A=list_length, B=Slider(10, range=0..100))
cosine = Cosine(Value=division)
sine = Sine(Value=division)
panel = Panel(sine)
panel_2 = Panel(cosine)

boundary_surfaces = BoundarySurfaces(Edges=circle)
subtraction = Subtraction(A=cosine, B=sine)
negative = Negative(Value=subtraction)
number_slider = Slider(2, range=0..10)
construct_domain = ConstructDomain(DomainStart=negative, DomainEnd=subtraction)
construct_domain_2 = ConstructDomain(DomainStart=negative, DomainEnd=subtraction)
number_slider_2 = Slider(3, range=0..100)
range = Range(Domain=construct_domain_2, Steps=number_slider)
range_2 = Range(Domain=construct_domain, Steps=number_slider)
sine_2 = Sine(Value=range)
cosine_2 = Cosine(Value=range_2)
multiplication = Multiplication(A=range_2, B=Slider(1, range=0..100))
multiplication_2 = Multiplication(A=range, B=number_slider_2)
multiplication_3 = Multiplication(A=sine_2, B=number_slider_2)
multiplication_4 = Multiplication(A=cosine_2, B=number_slider_2)
construct_point = ConstructPoint(XCoordinate=multiplication, YCoordinate=0, ZCoordinate=multiplication_4)
construct_point_2 = ConstructPoint(XCoordinate=multiplication_2, YCoordinate=0, ZCoordinate=multiplication_3)
pi = Pi(Factor=sine_2)
pi_2 = Pi(Factor=cosine_2)
vector_xyz = VectorXYZ(XComponent="1", YComponent=0, ZComponent=0)  # -> Vector, Length
negative_2 = Negative(Value=pi)
interpolate = Interpolate(Vertices=construct_point, Degree=3, Periodic=False, KnotStyle=1)  # -> Curve, Length, Domain
interpolate_2 = Interpolate(Vertices=construct_point_2, Degree=3, Periodic=False, KnotStyle=1)  # -> Curve, Length, Domain
rotate_3d = Rotate3D(Geometry=interpolate.Curve, Angle=pi_2, Center=Point(0, 0, 0), Axis=vector_xyz.Vector)  # -> Geometry, Transform
rotate_3d_2 = Rotate3D(Geometry=interpolate_2.Curve, Angle=negative_2, Center=Point(0, 0, 0), Axis=vector_xyz.Vector)  # -> Geometry, Transform
curve = Curve(rotate_3d.Geometry)
curve_2 = Curve(rotate_3d_2.Geometry)
number_slider_3 = Slider(1, range=0..1)
evaluate_curve = EvaluateCurve(Curve=reparameterize(curve), Parameter=panel_2)  # -> Point, Tangent, Angle
evaluate_curve_2 = EvaluateCurve(Curve=reparameterize(curve_2), Parameter=panel)  # -> Point, Tangent, Angle
amplitude = Amplitude(Vector=evaluate_curve.Tangent, Amplitude=number_slider_3)
amplitude_2 = Amplitude(Vector=evaluate_curve_2.Tangent, Amplitude=number_slider_3)
vector_display = VectorDisplay(Anchor=evaluate_curve.Point, Vector=amplitude)
dot_product = DotProduct(VectorA=evaluate_curve.Tangent, VectorB=evaluate_curve_2.Tangent, Unitize=False)
absolute = Absolute(Value=dot_product)
vector_display_2 = VectorDisplay(Anchor=evaluate_curve_2.Point, Vector=amplitude_2)
subtraction_2 = Subtraction(A="1", B=absolute)
panel_3 = Panel(dot_product)
ghpython_script = GhPythonScript(x=dot_product)  # -> out, a
# ---------- ghpython_script: Python ----------
__author__ = "Sculpture"
__version__ = "2022.09.11"

import rhinoscriptsyntax as rs

if 0.1 < x < 1.1:
    a = True
# ---------- end ghpython_script ----------
line = Line(StartPoint=evaluate_curve.Point, EndPoint=evaluate_curve_2.Point)
gradient = Gradient(
    LowerLimit=absolute,
    UpperLimit=subtraction_2,
    Parameter=dot_product,
    stops=[0.0441: RGB(21, 239, 255), 0.397: RGBA(255, 0, 255, 207), 1: RGB(0, 0, 0)])
panel_4 = Panel(ghpython_script.a)
object_bake = ObjectBake(
    BakeToggle=ghpython_script.a,
    GeometryObjects=line,
    Layer="GH_Bake",
    ObjectName="GH_Obj",
    ObjectColor=gradient,
    LayerColor=RGB(255, 255, 255))
