# Grasshopper definition gh_basics_Curve_004.gh (Grasshopper 1.0.7)

z = Slider(2, range=0..10)
number_slider = Slider(8, range=0..10)

# ----
# Parameters
number_slider_2 = Slider(14, range=0..30)
open_closed = BooleanToggle(False)

radius_of_spheres = Slider(1, range=0..1)

construct_point = ConstructPoint(XCoordinate=0, YCoordinate=0, ZCoordinate=z)
xy_plane = XYPlane(Origin=construct_point)
center_box = CenterBox(Base=xy_plane, X=number_slider, Y=number_slider, Z=1)
populate_3d = Populate3D(Region=center_box, Count=number_slider_2, Seed=Slider(265, range=0..1000))

negative = Negative(Value=number_slider)
construct_domain = ConstructDomain(DomainStart=negative, DomainEnd=number_slider)
rectangle = Rectangle(Plane=PlaneXY(0, 0, 0), XSize=construct_domain, YSize=construct_domain, Radius=0)  # -> Rectangle, Length
populate_2d = Populate2D(Region=rectangle.Rectangle, Count=number_slider_2, Seed=1)
vector_xyz = VectorXYZ(XComponent=0, YComponent=0, ZComponent="1")  # -> Vector, Length
delaunay_mesh = DelaunayMesh(Points=populate_3d, Plane=PlaneXY(0, 0, 0))
vector = Vector(vector_xyz.Vector)
point = Point(populate_2d)
mesh_ray = MeshRay(Mesh=delaunay_mesh, Point=point, Direction=vector)  # -> Point, Hit

panel = Panel(mesh_ray.Hit)

# ----
# Rhino 7 Educational Lab
# gh_basics_Curve_003
# Rhino Menu Bar
# CURVE
# Rhino
# Commands
# Polyline
# Polyline
# and
# Polyline
# thru Points
# On Mesh
polyline = PolyLine(Vertices=mesh_ray.Point, Closed=Toggle(True))
polyline_2 = PolyLine(Vertices=populate_3d, Closed=open_closed)

explode = Explode(Curve=polyline, Recursive=True)  # -> Segments, Vertices

# ----
# Geometry
# From
# 4 Points
# Normal
# to Surface
# Verticle
# to (C-)Plane
sphere = Sphere(Base=explode.Vertices, Radius=radius_of_spheres)
curve = Curve(polyline_2)

# ----
# Param Viewer
# (Data Structure)
# Panels
panel_2 = Panel(curve)
panel_3 = Panel(sphere)
param_viewer = ParamViewer(panel_2)
param_viewer_2 = ParamViewer(panel_3)

# ----
# SANDBOX
# (Playground)
deconstruct = Deconstruct(Point=populate_3d)  # -> XComponent, YComponent, ZComponent
panel_4 = Panel(deconstruct.YComponent)
sort_list = SortList(Keys=deconstruct.XComponent, ValuesValuesA=deconstruct.XComponent)  # -> Keys, ValuesValuesA
sort_list_2 = SortList(Keys=deconstruct.ZComponent, ValuesValuesA=deconstruct.ZComponent)  # -> Keys, ValuesValuesA
construct_point_2 = ConstructPoint(XCoordinate=sort_list.ValuesValuesA, YCoordinate=deconstruct.YComponent, ZCoordinate=deconstruct.ZComponent)
construct_point_3 = ConstructPoint(XCoordinate=deconstruct.XComponent, YCoordinate=deconstruct.YComponent, ZCoordinate=sort_list_2.ValuesValuesA)
panel_5 = Panel(sort_list_2.ValuesValuesA)
polyline_3 = PolyLine(Vertices=construct_point_3, Closed=open_closed)
polyline_4 = PolyLine(Vertices=construct_point_2, Closed=open_closed)
